# Grasshopper definition BrepTest.ghx (Grasshopper 1.0.7)
# plug-ins: Speckle 2

number_slider = Slider(3, range=0..10)
number_slider_2 = Slider(3, range=0..10)
number_slider_3 = Slider(2, range=0..10)
range = Range(Domain=Domain(0, 1), Steps=number_slider)
range_2 = Range(Domain="-2 to 2", Steps=number_slider_2)
pt = Point(Point(0, 0, 0))
number_slider_4 = Slider(0.4, range=0..1)
pt_2 = ConstructPoint(XCoordinate=graft(range), YCoordinate=range, ZCoordinate=0)
pt_3 = Point(Point(0.7966847394, 0.07208809119, 1.252480454))
pt_4 = Point(Point(0.7966847394, 0.07208809119, 0.135139581))
pt_5 = Point(Point(-0.2375516705, 0.07208809119, -0.2489613433))
pt_6 = ConstructPoint(XCoordinate=graft(range_2), YCoordinate=range_2, ZCoordinate=0)
pt_7 = ConstructPoint(XCoordinate=graft(range_2), YCoordinate=0, ZCoordinate=range_2)
cyl = Cylinder(Base=pt, Radius=0.5, Length=Slider(1, range=0..10))
box = CenterBox(Base=pt_4, X=number_slider_3, Y=number_slider_4, Z=number_slider_4)
srfgrid = SurfaceFromPoints(Points=flatten(pt_2), UCount=expr("x+1", number_slider), Interpolate=False)
box_2 = CenterBox(Base=pt_3, X=number_slider_4, Y=number_slider_4, Z=number_slider_3)
pt_8 = Point(Tree({0;0;0}: [Point(-2, -2, 0), Point(-2, -0.6666666667, 0), Point(-2, 0.6666666667, 0), Point(-2, 2, 0)], {0;0;1}: [Point(-0.6666666667, -2, 0), Point(-0.6666666667, -0.6666666667, -1.468956097), Point(-0.6666666667, 0.6666666667, 1.305453651), Point(-0.6666666667, 2, -0.9238310205)], {0;0;2}: [Point(0.6666666667, -2, 0), Point(0.6666666667, -0.6666666667, 2.759774879), Point(0.6666666667, 0.6666666667, -0.1358726263), Point(0.6666666667, 2, 0)], {0;0;3}: [Point(2, -2, -1.643371203), Point(2, -0.6666666667, 0), Point(2, 0.6666666667, 0), Point(2, 2, 0)]))
pt_9 = Point(Tree({0;0;0}: [Point(-2, 0, -2), Point(-2, 0, -0.6666666667), Point(-2, -1.157601878, 0.6666666667), Point(-2, -1.531644715, 2)], {0;0;1}: [Point(-0.6666666667, 0, -2), Point(-0.6666666667, -0.339197191, -0.6666666667), Point(-0.6666666667, 2.598013607, 0.6666666667), Point(-0.6666666667, 0, 2)], {0;0;2}: [Point(0.6666666667, -1.084035409, -2), Point(0.6666666667, 0.2769907449, -0.6666666667), Point(0.2187878199, -0.6758975856, 0.6666666667), Point(0.6666666667, -0.9859577286, 2)], {0;0;3}: [Point(2, 0, -2), Point(2, 2.242105939, -0.6666666667), Point(2, 0, 0.6666666667), Point(2, 0, 2)]))
cap = CapHoles(Brep=cyl)
box_3 = CenterBox(Base=PlaneXY(0, 0, 0), X=1, Y=1, Z=1)
box_4 = CenterBox(Base=pt_5, X=number_slider_4, Y=number_slider_3, Z=number_slider_4)
Z = UnitZ(Factor=Slider(3, range=0..10))
cir = Circle(Plane=PlaneXY(0, 0, 0), Radius=1)
srfgrid_2 = SurfaceFromPoints(Points=flatten(pt_8), UCount=expr("x+1", number_slider_2), Interpolate=False)
srfgrid_3 = SurfaceFromPoints(Points=flatten(pt_9), UCount=expr("x+1", number_slider_2), Interpolate=False)
brep = Brep(box_3)
trim = TrimSolid(Shape=srfgrid, Cutters=cap)
Z_2 = UnitZ(Factor=Slider(-0.6682, range=-1..1))
python = GhPythonScript(x=cir)  # -> out, a
# ---------- python: Python ----------
import Rhino.Geometry as rg

a = x.ToNurbsCurve()
# ---------- end python ----------
sdiff = SolidDifference(BrepsA=brep, BrepsB=cap)
extr = Extrude(Base=cir, Direction=Z)
sdiff_2 = SolidDifference(BrepsA=brep, BrepsB=[box_2, box, box_4, cap])
sdiff_3 = SolidDifference(BrepsA=brep, BrepsB=[box_2, box, box_4])
move = Move(Geometry=srfgrid_2, Motion=Z_2)  # -> Geometry, Transform
scale = Scale(Geometry=sdiff, Center=Point(0, 0, 0), Factor=Slider(10, range=0..10))  # -> Geometry, Transform
to_speckle = ToSpeckle(Objects=python.a, KitName="Objects")
python_2 = GhPythonScript(y=cyl)  # -> out, a, b; inputs x: Brep, y: Surface
# ---------- python_2: Python ----------
b = y.ToNurbsSurface()
# ---------- end python_2 ----------
flip = Flip(Surface=[srfgrid_2, srfgrid_3])  # -> Surface, Result
to_native = ToNative(Objects=to_speckle, KitName="Objects")
relay = Relay([move.Geometry, srfgrid_3])
sdiff_4 = SolidDifference(BrepsA=sdiff_2, BrepsB=relay)
to_speckle_2 = ToSpeckle(Objects=sdiff_4, KitName="Objects")
to_native_2 = ToNative(Objects=to_speckle_2, KitName="Objects")
srl = Serialize(O=to_speckle_2)
to_speckle_3 = ToSpeckle(Objects=srfgrid, KitName="Objects")
crv = Curve(to_native)
brep_2 = Brep(to_native_2)
deserialize = Deserialize(O=srl)
panel = Panel(to_speckle_3)
brep_3 = Brep([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])
preview = CustomPreview(
    Geometry=brep_2,
    Material={diffuse=RGB(221, 160, 221), emission=RGB(66, 48, 66), shine=0.5, specular=RGB(255, 255, 255), transparency=0})
to_native_3 = ToNative(Objects=deserialize, KitName="Objects")
to_speckle_4 = ToSpeckle(Objects=brep_3, KitName="Objects")
brep_4 = Brep(to_native_3)
debrep = DeconstructBrep(Brep=brep_2)  # -> Faces, Edges, Vertices
srl_2 = Serialize(O=to_speckle_4)
edges = BrepEdges(Brep=brep_2)  # -> Naked, Interior, NonManifold
edges_2 = BrepEdges(Brep=cyl)  # -> Naked, Interior, NonManifold
deserialize_2 = Deserialize(O=srl_2)
item = ListItem(List=debrep.Faces, Index=Slider(4, range=0..10), Wrap=True)
to_native_4 = ToNative(Objects=deserialize_2, KitName="Objects")
edges_3 = BrepEdges(Brep=item)  # -> Naked, Interior, NonManifold
item_2 = ListItem(List=edges.Naked, Index=Slider(0, range=0..4), Wrap=True)
item_3 = ListItem(List=edges_2.Naked, Index=Slider(0, range=0..4), Wrap=True)
knots = KnotVector(Degree=3, Periodic=False)
brep_5 = Brep(to_native_4)
number_slider_5 = Slider(6, range=0..10)
cp = ControlPoints(Curve=item_2)  # -> Points, Weights, Knots
cp_2 = ControlPoints(Curve=item_3)  # -> Points, Weights, Knots
curvepoint = PointOnCurve(debrep.Edges, parameter=0.333)
curvepoint_2 = PointOnCurve([debrep.Edges, edges.Interior], parameter=0.333)
multiplication = Multiplication(A=cp.Points, B=cp.Weights)
subtraction = Subtraction(A=cp.Points, B=cp_2.Points)
division = Division(A=subtraction, B=cp.Weights)
vlen = VectorLength(Vector=division)
panel_2 = Panel(vlen)
panel_3 = Panel(cp_2.Points)
