# Grasshopper definition ExtendObjectTest.ghx (Grasshopper 1.0.7)
# plug-ins: Speckle 2

list = Accounts(
    {"Account (alan@rynne.es | http://localhost:3000)": "c17e3b5af2f177869a733cca10850355"}, selected="Account (alan@rynne.es | http://localhost:3000)",
    selectedId="c17e3b5af2f177869a733cca10850355",
    selectedServer="http://localhost:3000")
number_slider = Slider(3, range=0..100)
series = Series(Start=0, Step=1, Count=number_slider)
charseq = CharSequence(Count=number_slider, CharPool="ABCDEFGHIJKLMNOPQRSTUVWXYZ", Format="{0}")
panel = Panel("""multi
line!!""")
cso = CreateSpeckleObject(A="/Original", B="/Original", C="/Original")  # -> Debug, SpeckleObject
panel_2 = Panel("old")
id_9abc86882e = CreateStream(Account=list, stream="9abc86882e http://localhost:3000 c17e3b5af2f177869a733cca10850355")
eso = ExtendSpeckleObject(SpeckleObject=cso.SpeckleObject, Keys=charseq, Values=series)
eso_2 = ExtendSpeckleObject(SpeckleObject=cso.SpeckleObject, Keys=charseq, Values=series)
send = Send(
    Data=eso_2,
    Stream=id_9abc86882e,
    Branch="main",
    AutoSend=False,
    BaseId="7e9d984eb60ff70096b739405fece275",
    CurrentComponentState="up_to_date",
    OutputWrappers="http://localhost:3000\t9abc86882e\t0b80ede0ea",
    UseDefaultCache=True)  # -> Commits, ObjectId, Data
receive = Receive(
    ID=graft(send.Commits),
    AutoReceive=False,
    CurrentComponentState="up_to_date",
    LastInfoMessage="Alan Rynne @ 2020-10-23T11:07:10.974Z: Grasshopper push. (id:0b80ede0ea)",
    ReceivedObjectId="7e9d984eb60ff70096b739405fece275",
    StreamWrapper="http://localhost:3000/streams/9abc86882e/commits/0b80ede0ea?u=c17e3b5af2f177869a733cca10850355")  # -> Data, Info
eso_3 = ExpandSpeckleObject(SpeckleObject=send.Data)  # -> A, B, C, A_2, B_2, C_2
eso_4 = ExpandSpeckleObject(SpeckleObject=receive.Data)
